# Grasshopper definition Test Script.ghx (Grasshopper 0.9.6)
# plug-ins: Python Interpreter, LunchBox

contour_spacing = Slider(50, range=10..10000)
min_floor = Slider(1250, range=-5000..5000)
max_floor = Slider(2500, range=0..5000)
waiwhetu_surface = Brep(<brep referenced from the Rhino model>)
waterfront_surface = Brep(<brep referenced from the Rhino model>)
waterfront_boundary = Curve(<curve referenced from the Rhino model>)
waiwhetu_boundary = Curve(<curve referenced from the Rhino model>)
bake_curves = BooleanToggle(False)
xy = XYPlane(Origin=Point(0, 0, 0))
mesh = Mesh(<mesh referenced from the Rhino model>)
mesh_2 = MeshBrep(
    Brep=waterfront_surface,
    Settings={Refine=True, JaggedSeams=False, SimplePlanes=True, GridMinCount=16, GridMaxCount=0, Tolerance=0, RefineAngle=0, MinTolerance=0, RelativeTolerance=0.65, MinEdgeLength=0.0001, MaxEdgeLength=0})
crv = Curve(waterfront_boundary)
mesh_3 = Mesh(mesh_2)
P = Plane(xy)
D = Number(contour_spacing)
mcomp = Decompose(Mesh=mesh_3)  # -> Vertices, Faces, Colours, Normals
pcomp = Decompose(Point=mcomp.Vertices)  # -> XComponent, YComponent, ZComponent
sort = SortList(Keys=pcomp.ZComponent)  # -> List, ValuesA
item = ListItem(List=reverse(sort.List), Index=0, Wrap=False)
item_2 = ListItem(List=sort.List, Index=0, Wrap=False)
h_min = Number(item_2)
h_max = Number(item)
subtraction = Subtraction(A=h_min, B=contour_spacing)
subtraction_2 = Subtraction(A=h_max, B=h_min)
division = Division(A=subtraction_2, B=D)
series = Series(Start=subtraction, Step=D, Count=division)
pl_offset = PlaneOffset(BasePlane=P, Offset=series)
sec = MeshPlane(Mesh=mesh_3, Plane=pl_offset)
clean = CleanTree(Data=sec, CleanInvalid=True, CleanEmpty=False)
crv_2 = Curve(flatten(clean))
join = JoinCurves(Curves=crv_2, Preserve=False)
smoothpline = SmoothPolyline(Polyline=join, Strength=1, Times=3)
crv_3 = Curve(flatten(smoothpline))
closing_the_contours = PythonScript(curves=crv_3, boundary=crv)  # -> out, fixed_curves, a
# ---------- closing_the_contours: Python ----------
import rhinoscriptsyntax as rs

fixed_curves = []
# Temp test:
a = []

edges = rs.ExplodeCurves(boundary)
north_edge = edges[2]
east_edge = edges[1]
south_edge = edges[0]
west_edge = edges[3]

SEpoint = rs.CurveStartPoint(east_edge)
NEpoint = rs.CurveEndPoint(east_edge)

for item in curves:
    if rs.IsCurveClosed(item) == False:
        original_height = rs.CurveStartPoint(item)[2]
        movement = (0, 0, (0 - original_height))
        rs.MoveObject(item, movement)
        # Temp test:
        a.append(item)
        north_intersections = rs.CurveCurveIntersection(item, north_edge)
        east_intersections = rs.CurveCurveIntersection(item, east_edge)
        south_intersections = rs.CurveCurveIntersection(item, south_edge)
        west_intersections = rs.CurveCurveIntersection(item, west_edge)
        
        # If they intersect twice on the same edge, close em
        try:
            if north_intersections[1][2]:
                joiner = rs.AddLine(rs.CurveEndPoint(item), rs.CurveStartPoint(item))
                new_curve = rs.JoinCurves((item, joiner))
                rs.MoveObject(new_curve, (0, 0, (original_height)))
                fixed_curves.append(new_curve[0])
        except:
            print Exception
            print "not a thing"
            
        try:
            if east_intersections[1][2]:
                joiner = rs.AddLine(rs.CurveEndPoint(item), rs.CurveStartPoint(item))
                new_curve = rs.JoinCurves((item, joiner))
                rs.MoveObject(new_curve, (0, 0, (original_height)))
                fixed_curves.append(new_curve[0])
        except:
            print Exception
            print "not a thing"
            
        try:
            if south_intersections[1][2]:
                joiner = rs.AddLine(rs.CurveEndPoint(item), rs.CurveStartPoint(item))
                new_curve = rs.JoinCurves((item, joiner))
                rs.MoveObject(new_curve, (0, 0, (original_height)))
                fixed_curves.append(new_curve[0])
        except:
            print Exception
            print "not a thing"
            
        try:
            if west_intersections[1][2]:
                joiner = rs.AddLine(rs.CurveEndPoint(item), rs.CurveStartPoint(item))
                new_curve = rs.JoinCurves((item, joiner))
                rs.MoveObject(new_curve, (0, 0, (original_height)))
                fixed_curves.append(new_curve[0])
        except:
            print Exception
            print "not a thing"
            

        # If the intersect on diagonal edges
        try:
            if (east_intersections[0][1]) and (south_intersections[0][1]):
                search_points = (rs.CurveEndPoint(item), rs.CurveStartPoint(item))
                # Finding the proper end point
                east_start = rs.PointArrayClosestPoint(search_points, east_intersections[0][1])
                south_start = rs.PointArrayClosestPoint(search_points, south_intersections[0][1])
                # Drawing lines to the edge boundary
                joinerb = rs.AddLine(search_points[south_start], SEpoint)
                joinera = rs.AddLine(search_points[east_start], SEpoint)
                new_curve = rs.JoinCurves((item, joinera, joinerb))
                rs.MoveObject(new_curve, (0, 0, (original_height)))
                fixed_curves.append(new_curve[0])
        except:
            print "no east and south ix"

        try:
            if (east_intersections[0][1]) and (north_intersections[0][1]):
                search_points = (rs.CurveEndPoint(item), rs.CurveStartPoint(item))
                # Finding the proper end point
                east_start = rs.PointArrayClosestPoint(search_points, east_intersections[0][1])
                north_start = rs.PointArrayClosestPoint(search_points, north_intersections[0][1])
                # Drawing lines to the edge boundary
                joinerb = rs.AddLine(search_points[north_start], NEpoint)
                joinera = rs.AddLine(search_points[east_start], NEpoint)
                new_curve = rs.JoinCurves((item, joinera, joinerb))
                rs.MoveObject(new_curve, (0, 0, (original_height)))
                fixed_curves.append(new_curve[0])
        except:
            print Exception
            print "no east and north ix"

        try:
            if (north_intersections[0][1]) and (south_intersections[0][1]):
                search_points = (rs.CurveEndPoint(item), rs.CurveStartPoint(item))
                # Finding the proper end point
                north_start = rs.PointArrayClosestPoint(search_points, north_intersections[0][1])
                south_start = rs.PointArrayClosestPoint(search_points, south_intersections[0][1])
                # Drawing lines to the edge boundary
                joinera = rs.AddLine(search_points[north_start], NEpoint)
                joinerb = rs.AddLine(search_points[south_start], SEpoint)
                joinerc = rs.AddLine(NEpoint, SEpoint)
                new_curve = rs.JoinCurves((item, joinera, joinerb, joinerc))
                rs.MoveObject(new_curve, (0, 0, (original_height)))
                fixed_curves.append(new_curve[0])
        except:
            print Exception
            print "no north and south ix"

            
    else:
        fixed_curves.append(item)
# ---------- end closing_the_contours ----------
crv_4 = Curve(closing_the_contours.a)
crv_5 = Curve(closing_the_contours.fixed_curves)
colouring_the_contours = PythonScript(curves=crv_5, floor_min=min_floor, floor_max=max_floor)  # -> out, contours, layer_names, parameters
# ---------- colouring_the_contours: Python ----------
import math
import rhinoscriptsyntax as rs

contour_heights = []
parameters = []
contours = []
layer_names = []

# Gathering all the height options
for item in curves:
    height = rs.CurveStartPoint(item)[2]
    if height < floor_min:
        print 'skipped'
        # This height is a flooring minimum
    elif height > floor_max:
        print 'skipped'
        # This height is a flooring maximum
    else:
        contour_heights.append(height)
        if rs.IsCurveClosed(item):
            contours.append(rs.CloseCurve(item))
        else:
            contours.append(item)
        
        

processed_heights = list(set(contour_heights))
processed_heights.sort()

low = min(processed_heights)
high = max(processed_heights)
amount = len(processed_heights)

print low
print high
print amount

print processed_heights

# Processing all the height options
for item in contours:
    index = processed_heights.index(rs.CurveStartPoint(item)[2]) + 2
    param = index / amount
    layer_name = "Contours @ %i" % (rs.CurveStartPoint(item)[2])
    layer_names.append(layer_name)
    parameters.append(param)
# ---------- end colouring_the_contours ----------
gradient = Gradient(
    LowerLimit=0,
    UpperLimit=1,
    Parameter=colouring_the_contours.parameters,
    stops=[0.0963: RGB(30, 144, 255), 1: RGB(192, 0, 192)])
gradient_2 = Gradient(
    LowerLimit=0,
    UpperLimit=1,
    Parameter=colouring_the_contours.parameters,
    stops=[0: RGB(255, 0, 0), 0.503: RGB(255, 255, 0), 1: RGB(0, 255, 0)])
gradient_3 = Gradient(
    LowerLimit=0,
    UpperLimit=1,
    Parameter=colouring_the_contours.parameters,
    stops=[0.00607: RGB(255, 255, 255), 0.998: RGB(0, 0, 0)])
str = String(colouring_the_contours.layer_names)
crv_6 = Curve(colouring_the_contours.contours)
col = Colour(gradient_3)
bake = ObjectBake(
    BakeToggle=bake_curves,
    GeometryObjects=crv_6,
    Layer=str,
    ObjectName="GH_Obj",
    ObjectColor=col,
    LayerColor=RGB(255, 255, 255))
preview = CustomPreview(Geometry=crv_6, Shader=col)
